# Grasshopper definition 3DSlotConstruction01.gh (Grasshopper 1.0.8)
# plug-ins: opennest_2 Info

# 3D Slot Construction + Nesting Template v1
geometry = Geometry(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)
geometry_2 = Geometry(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)

# ---- group: Nesting
options = Options(
    Rotations=Slider(4, range=0..360),
    Wiggle=Slider(0, range=0..5.01),
    PlacementType=Slider(0, range=0..2),
    Spacing=Slider(1, range=0..100),
    Seed=Slider(30, range=0..100),
    SimplifyTolerance=Slider(1, range=0.01..10),
    Mutation=Slider(10, range=1..100),
    Population=Slider(10000, range=1..100000),
    Time=Slider(0, range=0..120),
    SheetFont="MecSoft_Font-1 -10")

# ---- group: create Mesh Sphere
radius = Slider(87, range=0..100)
uv_count = Slider(5, range=0..10)

mesh_sphere = MeshSphere(Base=PlaneXY(0, 0, 0), Radius=radius, UCount=uv_count, VCount=uv_count)
triangulate = Triangulate(Mesh=mesh_sphere)  # -> Mesh, Count

triangulated_mesh = Mesh(triangulate.Mesh)

# ---- group: Simple slot example
material_width = Slider(3.8, range=0..10)
surface = Surface(geometry)
surface_2 = Surface(geometry_2)
material_width_num = Number(material_width)

merge = Merge(Data1=flatten(surface), Data2=flatten(surface_2))
region_slits = RegionSlits(Regions=flatten(merge), Width=material_width, Gap=0)  # -> Regions, Topology

surfaces = Surface(region_slits.Regions)

# ---- group: create circles on edges
circle_radius = Slider(10, range=0..10)
triangulated_mesh_2 = Mesh(triangulated_mesh)

mesh_edges = MeshEdges(Mesh=triangulated_mesh_2)  # -> NakedEdges, InteriorEdges, NonManifoldEdges
evaluate_length = EvaluateLength(Curve=mesh_edges.InteriorEdges, Length="0.5", Normalized=True)  # -> Point, Tangent, Parameter
perp_frame = PerpFrame(Curve=mesh_edges.InteriorEdges, Parameter=evaluate_length.Parameter)
circle = Circle(Plane=perp_frame, Radius=circle_radius)

circle_surfaces = Surface(circle)

# ---- group: Get Mesh Faces as Surfaces
offset_to_the_inside = Slider(-0.9, range=-10..0)
triangulated_mesh_3 = Mesh(triangulated_mesh)

face_boundaries = FaceBoundaries(Mesh=triangulated_mesh_3)
offset_curve = OffsetCurve(Curve=face_boundaries, Distance=offset_to_the_inside, Corners=1)  # -> flatten(Curve)

mesh_face_surfaces = Surface(offset_curve)

# ---- group: Create Slots
# Author Info: Grasshopper Definition
# by Robin Godwyll
# 
# October 2025
# BURG University of Art and Design Halle, Germany
material_width_2 = Slider(2.1, range=0..10)
surface_3 = Surface(mesh_face_surfaces)
surface_4 = Surface(circle_surfaces)
material_width_num_2 = Number(material_width_2)

merge_2 = Merge(Data1=flatten(surface_3), Data2=flatten(surface_4))
region_slits_2 = RegionSlits(Regions=flatten(merge_2), Width=material_width_2, Gap=0)  # -> Regions, Topology

surfaces_2 = Surface(region_slits_2.Regions)

# ---- group: Create 3D Objects from 2D Surfaces
surface_5 = Surface(surfaces_2)
material_width_num_3 = Number(material_width_num_2)
panel = Panel("2")

division = Division(A=material_width_num_3, B=panel)
negative = Negative(Value=division)
merge_3 = Merge(Data1=division, Data2=negative)
offset_surface = OffsetSurface(Surface=surface_5, Distance=merge_3, Retrim=True)
loft = Loft(Curves=offset_surface, Options={Adjust=False, Closed=False, LoftEnds=0, LoftSimp=0, LoftType=0, Rebuild=10, Refit=0.01})
merge_4 = Merge(Data1=offset_surface, Data2=loft)
brep_join = BrepJoin(Breps=merge_4)  # -> Breps, Closed

brep = Brep(brep_join.Breps)

# ---- group: Orient Surfaces to Origin
surfaces_3 = Surface(surfaces_2)

area = Area(Geometry=surfaces_3)  # -> Area, Centroid
surface_closest_point = SurfaceClosestPoint(Point=area.Centroid, Surface=surfaces_3)  # -> Point, UVPoint, Distance
evaluate_surface = EvaluateSurface(Surface=surfaces_3, Point=surface_closest_point.UVPoint)  # -> Point, Normal, UDirection, VDirection, Frame
orient = Orient(Geometry=surfaces_3, Source=evaluate_surface.Frame, Target=PlaneXY(0, 0, 0))  # -> flatten(Geometry), Transform

curves = Curve(orient.Geometry)

# ---- group: Nesting
# Nesting (OpenNest2)
sheet_width = Slider(200, range=0..1000)
sheet_length = Slider(540, range=0..1000)
number_of_sheets = Slider(5, range=0..10)
run_nesting_optimisation = BooleanToggle(False)
curves_2 = Curve(curves)

rectangle = Rectangle(Plane=PlaneXY(0, 0, 0), XSize=sheet_width, YSize=sheet_length, Radius=0)  # -> Rectangle, Length
sheets = Sheets(Polylines=rectangle.Rectangle, Gap=0.1, Copies=number_of_sheets)  # -> Sheets, Polylines
geometry_3 = Geometry(Outlines=curves_2, Simplify="1", Hull=False)  # -> Geometry, Borders
opennest2 = OpenNest2(Sheets=sheets.Sheets, Geometry=geometry_3.Geometry, Options=options, Iterations=1, Run=run_nesting_optimisation)  # -> Sheets, Borders, AllGeo, Transforms, SheetId, SheetTxt, Attributes

sheet_outline_curves = Curve(opennest2.Sheets)
cut_outlines_curves = Curve(opennest2.Borders)
