# Grasshopper definition CNC_Patterns_v1.gh (Grasshopper 1.0.8)
# plug-ins: Pufferfish, ClipperComponents

curve = Curve(<curve referenced from the Rhino model>)
# CNC Patterns v1.2
curve_2 = Curve(<curve referenced from the Rhino model>)
curve_3 = Curve(curve_2)
curve_4 = Curve(<curve referenced from the Rhino model>)
curve_along = Curve(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)
curve_1 = Curve(<curve referenced from the Rhino model>)
curve_2_2 = Curve(<curve referenced from the Rhino model>)
curve_1_2 = Curve(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)
curve_2_3 = Curve(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)
curve_5 = Curve(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)
curve_6 = Curve(<curve referenced from the Rhino model>)

# ---- group: Array Along Curve
# Array along Curve
amount_along_curve = Slider(100, range=1..100)
curve_to_multiply = Curve(<curve referenced from the Rhino model>)
curve_along_2 = Curve(<curve referenced from the Rhino model>)
curve_array = CurveArray(Geometry=curve_to_multiply, Curve=curve_along_2, Count=amount_along_curve)  # -> Geometry, Transform
image_sampler = ImageSampler(
    FilePath="/var/folders/4l/236vf3fd1f1gls6139vttf0w0000gn/T/TemporaryItems/NSIRD_screencaptureui_fu5yF6/Screenshot 2025-10-26 at 21.52.30.png",
    Filter="Colour",
    Interpolate=False,
    Umax=1,
    Umin=0,
    Vmax=1,
    Vmin=0,
    Wrap=1)
curves = Curve(flatten(curve_array.Geometry))

# ---- group: Kaleidoscope Array
copies = Slider(22, range=1..100)
copies_num = Integer(copies)
midpoint_point = Point(Point(0, 0, 0))
curve_7 = Curve(curve_6)
kaleidoscope = Kaleidoscope(Geometry=curve_7, Plane=midpoint_point, Segments=copies_num)  # -> Geometry, Transform
image_sampler_2 = ImageSampler(
    FilePath="/var/folders/4l/236vf3fd1f1gls6139vttf0w0000gn/T/TemporaryItems/NSIRD_screencaptureui_vkfCea/Screenshot 2025-10-26 at 23.35.53.png",
    Filter="Colour",
    Interpolate=False,
    Umax=1,
    Umin=0,
    Vmax=1,
    Vmin=0,
    Wrap=1)
curves_2 = Curve(flatten(kaleidoscope.Geometry))

# ---- group: Tween two curves
# Tween two Curves Once
tween_factor = Slider(0.406, range=0..1)
curve_1_3 = Curve(curve_1)
curve_2_4 = Curve(curve_2_2)
image_sampler_3 = ImageSampler(
    FilePath="/var/folders/4l/236vf3fd1f1gls6139vttf0w0000gn/T/TemporaryItems/NSIRD_screencaptureui_sgYCpR/Screenshot 2025-10-26 at 23.18.01.png",
    Filter="Colour",
    Interpolate=False,
    Umax=1,
    Umin=0,
    Vmax=1,
    Vmin=0,
    Wrap=1)
tween_two_curves = TweenTwoCurves(CurveA=curve_1_3, CurveB=curve_2_4, Factor=tween_factor, Refit=0, PointSample=0)
tween_curve = Curve(tween_two_curves)

# ---- group: Squiggle Curves
number_slider = Slider(20, range=0..1000)
number_slider_2 = Slider(19, range=0..50)
curve_type = ValueList({"Polyline": 0, "Smooth Curve": 1}, selected="Smooth Curve")
curve_8 = Curve(curve_4)
image_sampler_4 = ImageSampler(
    FilePath="/var/folders/4l/236vf3fd1f1gls6139vttf0w0000gn/T/TemporaryItems/NSIRD_screencaptureui_QGHESQ/Screenshot 2025-10-27 at 00.30.13.png",
    Filter="Colour",
    Interpolate=False,
    Umax=1,
    Umin=0,
    Vmax=1,
    Vmin=0,
    Wrap=1)

divide_curve = DivideCurve(Curve=curve_8, Count=number_slider, Kinks=False)  # -> Points, Tangents, Parameters
closed = Closed(Curve=curve_8)  # -> Closed, Periodic
list_length = ListLength(List=divide_curve.Parameters)
horizontal_frame = HorizontalFrame(Curve=curve_8, Parameter=divide_curve.Parameters)
negative = Negative(Value=number_slider_2)
deconstruct_plane = DeconstructPlane(Plane=horizontal_frame)  # -> Origin, XAxis, YAxis, ZAxis
merge = Merge(Data1=number_slider_2, Data2=negative)
repeat_data = RepeatData(Data=merge, Length=list_length)
amplitude = Amplitude(Vector=deconstruct_plane.YAxis, Amplitude=repeat_data)
move = Move(Geometry=deconstruct_plane.Origin, Motion=amplitude)  # -> Geometry, Transform
interpolate = Interpolate(Vertices=move.Geometry, Degree=3, Periodic=False, KnotStyle=1)  # -> Curve, Length, Domain
polyline = PolyLine(Vertices=move.Geometry, Closed=closed.Closed)
stream_filter = StreamFilter(Gate=curve_type, Stream0=polyline, Stream1=interpolate.Curve)

curve_9 = Curve(stream_filter)

# ---- group: Polar Array
# Author Info: Grasshopper Definition
# by Robin Godwyll
# 
# October 2025
# BURG University of Art and Design Halle, Germany
copies_2 = Slider(6, range=1..100)
angle = Slider(186, range=0..360)
number = Integer(copies_2)
curve_10 = Curve(curve_3)
midpoint_point_2 = Point(Point(0, 0, 0))
angle_degrees = Number(angle)
image_sampler_5 = ImageSampler(
    FilePath="/var/folders/4l/236vf3fd1f1gls6139vttf0w0000gn/T/TemporaryItems/NSIRD_screencaptureui_oHY5kv/Screenshot 2025-10-26 at 21.40.04.png",
    Filter="Colour",
    Interpolate=False,
    Umax=1,
    Umin=0,
    Vmax=1,
    Vmin=0,
    Wrap=1)

radians = Radians(Degrees=angle_degrees)
polar_array = PolarArray(Geometry=curve_10, Plane=midpoint_point_2, Count=number, Angle=radians)  # -> Geometry, Transform

curves_3 = Curve(flatten(polar_array.Geometry))

# ---- group: Rectangular Array
size_x = Slider(123.9, range=0..300)
size_y = Slider(158.7, range=0..300)
amount_x = Slider(4, range=1..100)
amount_y = Slider(4, range=1..100)
midpoint_point_3 = Point(Point(0, 0, 0))
curve_11 = Curve(curve_3)
image_sampler_6 = ImageSampler(
    FilePath="/var/folders/4l/236vf3fd1f1gls6139vttf0w0000gn/T/TemporaryItems/NSIRD_screencaptureui_ZGGcM7/Screenshot 2025-10-26 at 21.48.39.png",
    Filter="Colour",
    Interpolate=False,
    Umax=1,
    Umin=0,
    Vmax=1,
    Vmin=0,
    Wrap=1)

rectangular = Rectangular(Plane=midpoint_point_3, SizeX=size_x, SizeY=size_y, ExtentX=amount_x, ExtentY=amount_y)  # -> Cells, Points
point = Point(rectangular.Points)
orient = Orient(Geometry=curve_11, Source=PlaneXY(0, 0, 0), Target=point)  # -> Geometry, Transform

curves_4 = Curve(flatten(orient.Geometry))

# ---- group: Offset Curve
corners = ValueList({"Round": 0, "Square": 1, "Miter": 2}, selected="Square")
offset_amount = Slider(9, range=0..100)
offset_distance = Slider(14.4, range=0..75)
curve_to_offset = Curve(curve_3)
image_sampler_7 = ImageSampler(
    FilePath="/var/folders/4l/236vf3fd1f1gls6139vttf0w0000gn/T/TemporaryItems/NSIRD_screencaptureui_iG95q3/Screenshot 2025-10-26 at 22.36.38.png",
    Filter="Colour",
    Interpolate=False,
    Umax=1,
    Umin=0,
    Vmax=1,
    Vmin=0,
    Wrap=1)

series = Series(Start=0, Step=offset_distance, Count=offset_amount)
polyline_offset = PolylineOffset(
    Polylines=curve_to_offset,
    Distance=series,
    Plane=Plane(origin=(0, 0, 0), x=(0, 0, 0), y=(0, 0, 0)),
    Tolerance=0.001,
    ClosedFillet=corners,
    OpenFillet=corners,
    Miter=2)  # -> Contour, Holes

inner_curves = Curve(flatten(polyline_offset.Holes))
outer_curves = Curve(flatten(polyline_offset.Contour))

# ---- group: Circle Size image mapper
# Circle size image mapper
circle_scale_min = Slider(0, range=0..100)
circle_scale_max = Slider(1.5, range=0..50)
number_slider_3 = Slider(40, range=1..100)
grid_size = Slider(200, range=0..1000)
image_sampler_8 = ImageSampler(
    FilePath="/var/folders/4l/236vf3fd1f1gls6139vttf0w0000gn/T/TemporaryItems/NSIRD_screencaptureui_H0OMgn/Screenshot 2025-10-26 at 22.03.39.png",
    Filter="Colour",
    Interpolate=False,
    Umax=1,
    Umin=0,
    Vmax=1,
    Vmin=0,
    Wrap=1)

range = Range(Domain=Domain(0, 1), Steps=number_slider_3)
cross_reference = CrossReference(ListListA=range, ListListB=range, CrossMode=1)  # -> ListListA, ListListB
construct_point = ConstructPoint(XCoordinate=cross_reference.ListListA, YCoordinate=cross_reference.ListListB, ZCoordinate=0)
image_sampler_9 = ImageSampler(
    construct_point,
    FilePath="/Users/robin/Desktop/Screenshot 2025-10-26 at 21.56.19.png",
    Filter="Value",
    Interpolate=False,
    Umax=1,
    Umin=0,
    Vmax=1,
    Vmin=0,
    Wrap=1)
construct_domain = ConstructDomain(DomainStart=circle_scale_min, DomainEnd=circle_scale_max)
scale = Scale(Geometry=construct_point, Center=Point(0, 0, 0), Factor=grid_size)  # -> Geometry, Transform
remap_numbers = RemapNumbers(Value=image_sampler_9, Source=Domain(0, 1), Target=construct_domain)  # -> Mapped, Clipped
circle = Circle(Plane=scale.Geometry, Radius=remap_numbers.Mapped)

circles = Circle(circle)

# ---- group: Curve Size image mapper
# Curve size image mapper
circle_scale_min_2 = Slider(0, range=0..100)
circle_scale_max_2 = Slider(0.5, range=0..10)
number_slider_4 = Slider(40, range=1..100)
grid_size_2 = Slider(921, range=0..1000)
curve_to_multiply_and_scale = Curve(curve_3)
image_sampler_10 = ImageSampler(
    FilePath="/var/folders/4l/236vf3fd1f1gls6139vttf0w0000gn/T/TemporaryItems/NSIRD_screencaptureui_MiKVKF/Screenshot 2025-10-26 at 22.12.07.png",
    Filter="Colour",
    Interpolate=False,
    Umax=1,
    Umin=0,
    Vmax=1,
    Vmin=0,
    Wrap=1)

range_2 = Range(Domain=Domain(0, 1), Steps=number_slider_4)
cross_reference_2 = CrossReference(ListListA=range_2, ListListB=range_2, CrossMode=1)  # -> ListListA, ListListB
construct_point_2 = ConstructPoint(XCoordinate=cross_reference_2.ListListA, YCoordinate=cross_reference_2.ListListB, ZCoordinate=0)
construct_domain_2 = ConstructDomain(DomainStart=circle_scale_min_2, DomainEnd=circle_scale_max_2)
image_sampler_11 = ImageSampler(
    construct_point_2,
    FilePath="/Users/robin/Desktop/Screenshot 2025-10-26 at 21.56.19.png",
    Filter="Value",
    Interpolate=False,
    Umax=1,
    Umin=0,
    Vmax=1,
    Vmin=0,
    Wrap=1)
scale_2 = Scale(Geometry=construct_point_2, Center=Point(0, 0, 0), Factor=grid_size_2)  # -> Geometry, Transform
remap_numbers_2 = RemapNumbers(Value=image_sampler_11, Source=Domain(0, 1), Target=construct_domain_2)  # -> Mapped, Clipped
orient_2 = Orient(Geometry=curve_to_multiply_and_scale, Source=PlaneXY(0, 0, 0), Target=scale_2.Geometry)  # -> Geometry, Transform
scale_3 = Scale(Geometry=orient_2.Geometry, Center=scale_2.Geometry, Factor=remap_numbers_2.Mapped)  # -> Geometry, Transform

scaled_curves = Curve(scale_3.Geometry)

# ---- group: Twisting Offset
angle_multiplier = Slider(3, range=0..10)
sample_distance = Slider(10, range=0..10)
angle_2 = Slider(165, range=0..360)
width = Slider(320, range=0.1..500)
number_of_offsets = Slider(13, range=2..100)
curve_12 = Curve(<curve referenced from the Rhino model>)
curve_to_offset_2 = Curve(curve_12)
image_sampler_12 = ImageSampler(
    FilePath="/var/folders/4l/236vf3fd1f1gls6139vttf0w0000gn/T/TemporaryItems/NSIRD_screencaptureui_fhFOs1/Screenshot 2025-10-27 at 00.41.18.png",
    Filter="Colour",
    Interpolate=False,
    Umax=1,
    Umin=0,
    Vmax=1,
    Vmin=0,
    Wrap=1)

multiplication = Multiplication(A=angle_2, B=angle_multiplier)
divide_length = DivideLength(Curve=curve_to_offset_2, Length=sample_distance)  # -> Points, Tangents, Parameters
radians_2 = Radians(Degrees=multiplication)
list_length_2 = ListLength(List=divide_length.Parameters)
negative_2 = Negative(Value=width)
horizontal_frame_2 = HorizontalFrame(Curve=curve_to_offset_2, Parameter=divide_length.Parameters)
construct_domain_3 = ConstructDomain(DomainStart=negative_2, DomainEnd=width)
deconstruct_plane_2 = DeconstructPlane(Plane=horizontal_frame_2)  # -> Origin, XAxis, YAxis, ZAxis
range_3 = Range(Domain=radians_2, Steps=expr("x-1", list_length_2))
rotate = Rotate(Vector=deconstruct_plane_2.YAxis, Axis=deconstruct_plane_2.ZAxis, Angle=range_3)
range_4 = Range(Domain=construct_domain_3, Steps=expr("x-1", number_of_offsets))
amplitude_2 = Amplitude(Vector=rotate, Amplitude=graft(range_4))
move_2 = Move(Geometry=flatten(deconstruct_plane_2.Origin), Motion=amplitude_2)  # -> Geometry, Transform
polyline_2 = PolyLine(Vertices=move_2.Geometry, Closed=False)  # -> flatten(Polyline)

streak_curves = Curve(polyline_2)

# ---- group: Offset Curve Simple
offset_distance_2 = Slider(-40, range=-100..100)
offset_amount_2 = Slider(8, range=0..100)
corners_2 = ValueList({"Round": 0, "Square": 1, "Miter": 2}, selected="Square")
curve_to_offset_3 = Curve(curve_5)
image_sampler_13 = ImageSampler(
    FilePath="/var/folders/4l/236vf3fd1f1gls6139vttf0w0000gn/T/TemporaryItems/NSIRD_screencaptureui_JvBsuL/Screenshot 2025-10-26 at 23.40.01.png",
    Filter="Colour",
    Interpolate=False,
    Umax=1,
    Umin=0,
    Vmax=1,
    Vmin=0,
    Wrap=1)

series_2 = Series(Start=0, Step=offset_distance_2, Count=offset_amount_2)
offset_curve = OffsetCurve(Curve=curve_to_offset_3, Distance=series_2, Corners=1)

outer_curves_2 = Curve(flatten(offset_curve))

# ---- group: Tween two curves multiple
# Tween two Curves multiple times
number_slider_5 = Slider(13, range=1..20)
curve_1_4 = Curve(curve_1_2)
curve_2_5 = Curve(curve_2_3)
image_sampler_14 = ImageSampler(
    FilePath="/var/folders/4l/236vf3fd1f1gls6139vttf0w0000gn/T/TemporaryItems/NSIRD_screencaptureui_wz4lje/Screenshot 2025-10-26 at 22.49.22.png",
    Filter="Colour",
    Interpolate=False,
    Umax=1,
    Umin=0,
    Vmax=1,
    Vmin=0,
    Wrap=1)

range_5 = Range(Domain=Domain(0, 1), Steps=number_slider_5)
tween_two_curves_2 = TweenTwoCurves(CurveA=curve_1_4, CurveB=curve_2_5, Factor=range_5, Refit=0, PointSample=0)

tween_curves = Curve(flatten(tween_two_curves_2))
