# Grasshopper definition SimpleGcodeCreation.gh (Grasshopper 1.0.8)

end_gcode = Panel("; End of File add commands here")

# ---- group: Create sphere and Slice
slice_distance = Slider(1.5, range=0..5)
# Simple Gcode Creation v1
radius = Slider(35, range=0..100)
u_count = Slider(10, range=2..70)
v_count = Slider(13, range=2..70)

mesh_sphere = MeshSphere(Base=PlaneXY(0, 0, 0), Radius=radius, UCount=u_count, VCount=v_count)
contour = Contour(Shape=mesh_sphere, Point=Point(0, 0, 0), Direction=Vector(0, 0, 1), Distance=slice_distance)

slice_contour_curves = Curve(contour)

# ---- group: Deconstruct Line into Numbers
slice_contour_curves_2 = Curve(slice_contour_curves)

control_points = ControlPoints(Curve=slice_contour_curves_2)  # -> Points, Weights, Knots
deconstruct = Deconstruct(Point=control_points.Points)  # -> XComponent, YComponent, ZComponent

z_component_number = Number(deconstruct.ZComponent)
y_component_number = Number(deconstruct.YComponent)
# Author Info: Grasshopper Definition
# by Robin Godwyll
# 
# October 2025
# BURG University of Art and Design Halle, Germany
x_component_number = Number(deconstruct.XComponent)

# ---- group: create Gcode Lines from values
x_component_number_2 = Number(x_component_number)
y_component_number_2 = Number(y_component_number)
z_component_number_2 = Number(z_component_number)

concatenate = Concatenate(FragmentA="Z", FragmentB=z_component_number_2)
concatenate_2 = Concatenate(FragmentA="X", FragmentB=x_component_number_2)
concatenate_3 = Concatenate(FragmentA="Y", FragmentB=y_component_number_2)
move_command = Panel("G0")
leerzeichen = Panel(" ")
concatenate_4 = Concatenate(
    MoveCommand=move_command,
    Leerzeichen=leerzeichen,
    FragmentA=concatenate_2,
    Leeerzeichen=leerzeichen,
    FragmentB=concatenate_3,
    Leerzeichen_2=leerzeichen,
    FragmentA_2=concatenate)  # -> flatten(Result)

gcode_lines_txt = Text(concatenate_4)

# ---- group: Add Setup Codes
# Comment: Save Gcode:
# - Right click into the panel
# - select "save data only"
# - paste into text editor
# - save as .gcode file
gcode_lines_txt_2 = Text(gcode_lines_txt)
start_gcode = Panel("G90")
merge = Merge(Data1=start_gcode, Data2=gcode_lines_txt_2, Data3=end_gcode)
full_gcode = Panel(merge)
